# Grasshopper definition test01.gh (Grasshopper 1.0.8)
# plug-ins: RhinoCodePluginGH, MeshEdit Components

pt = Point(Tree({0}: [Point(0, 800, 10.75790194), Point(34.72598587, 800, 8.75790194), Point(55, 800, -11.24209806), Point(61.91968224, 800, -37.60116137), Point(56.91968224, 800, -50.4348426), Point(51.34551169, 800, -99.87876893), Point(14.72598587, 800, -116.8787689), Point(0, 800, -116.8787689)], {1}: [Point(0, 881.3343783, 18.25790194), Point(34.72598587, 881.3343783, 18.25790194), Point(82.33763683, 881.3343783, 15.25790194), Point(82.33763683, 881.3343783, -38.60116137), Point(115.2124651, 881.3343783, -48.22949273), Point(97.85521735, 881.3343783, -92.31802166), Point(25.72598587, 881.3343783, -141.8787689), Point(0, 881.3343783, -141.8787689)], {2}: [Point(0, 998.0771873, 18.25790194), Point(34.72598587, 998.0771873, 18.25790194), Point(82.33763683, 998.0771873, 15.25790194), Point(82.33763683, 998.0771873, -38.60116137), Point(115.2124651, 998.0771873, -55.08805662), Point(97.85521735, 998.0771873, -92.31802166), Point(25.72598587, 998.0771873, -141.8787689), Point(0, 998.0771873, -141.8787689)], {3}: [Point(0, 1152.957751, 1.854295127), Point(14.72598587, 1152.957751, 1.854295127), Point(30, 1162.957751, -9.704530279), Point(30, 1162.957751, -20.69167303), Point(27.64558823, 1150.457751, -39.21586264), Point(27.64558823, 1140.457751, -54.34253224), Point(18.72598587, 1130, -69.73790245), Point(0, 1130, -69.73790245)]))
item = ListItem(List=pt, Index=0, Wrap=True)
split = SplitTree(Data=pt, Masks=flatten("{1,2}"))  # -> Positive, Negative
yz = YZPlane(Origin=item)
item_2 = ListItem(List=flatten(yz), Index=0, Wrap=True)
partition = PartitionList(List=split.Positive, Size="2")
bang = ExplodeTree(Data=partition)  # -> Branch0, Branch1, Branch2, Branch3, Branch4, Branch5, Branch6, Branch7
number_slider = Slider(11, range=0..20)
number_slider_2 = Slider(14, range=0..20)
number_slider_3 = Slider(11, range=2..20)
number_slider_4 = Slider(17, range=0..20)
pt_2 = Point(Point(0, 0, 0))
neg = Negative(Value=Slider(0.5, range=0..1))
Z = UnitZ(Factor=Slider(25, range=0..1000))
swatch = ColourSwatch(SwatchColor=RGB(196, 192, 192))
pi = Pi(Factor=neg)

hullwidth = Slider(-10, range=-10..10)
wingspan = Slider(10, range=-10..10)
wingstart = Slider(0, range=-10..10)
wingend = Slider(0, range=-10..10)

hullwidth_2 = GetNumber(hullwidth, AtLeast=0, AtMost=2, Maximum=1.797693135e+308, Minimum=-1.797693135e+308, TreeAccess=False)
wingspan_2 = GetNumber(wingspan, AtLeast=1, AtMost=2147483647, Maximum=1.797693135e+308, Minimum=-1.797693135e+308, TreeAccess=False)
wingstart_2 = GetNumber(wingstart, AtLeast=1, AtMost=2147483647, Maximum=1.797693135e+308, Minimum=-1.797693135e+308, TreeAccess=False)
wingend_2 = GetNumber(wingend, AtLeast=1, AtMost=2147483647, Maximum=1.797693135e+308, Minimum=-1.797693135e+308, TreeAccess=False)

remap = RemapNumbers(Value=hullwidth_2, Source="-10 to 10", Target="2 to 10")  # -> Mapped, Clipped
remap_2 = RemapNumbers(Value=wingstart_2, Source="-10 to 10", Target="-10 to 15")  # -> Mapped, Clipped
remap_3 = RemapNumbers(Value=wingend_2, Source="-10 to 10", Target="-10 to 15")  # -> Mapped, Clipped
remap_4 = RemapNumbers(Value=wingspan_2, Source="-10 to 10", Target="-5 to 12")  # -> Mapped, Clipped
multiplication = Multiplication(A=remap_4.Mapped, B="5")
multiplication_2 = Multiplication(A=remap.Clipped, B="5")
multiplication_3 = Multiplication(A=remap_2.Mapped, B="5")
multiplication_4 = Multiplication(A=remap_3.Mapped, B="5")

Y = UnitY(Factor=multiplication_4)
Y_2 = UnitY(Factor=multiplication_3)
X = UnitX(Factor=multiplication_2)
X_2 = UnitX(Factor=multiplication)

move = Move(Geometry=bang.Branch1, Motion=X)  # -> Geometry, Transform
move_2 = Move(Geometry=bang.Branch2, Motion=X_2)  # -> Geometry, Transform
move_3 = Move(Geometry=bang.Branch5, Motion=X)  # -> Geometry, Transform
move_4 = Move(Geometry=bang.Branch6, Motion=X_2)  # -> Geometry, Transform
merge = Merge(Data1=bang.Branch0, Data2=move.Geometry, Data3=move_2.Geometry, Data4=bang.Branch3)
merge_2 = Merge(Data1=bang.Branch4, Data2=move_3.Geometry, Data3=move_4.Geometry, Data4=bang.Branch7)
move_5 = Move(Geometry=merge, Motion=Y_2)  # -> Geometry, Transform
move_6 = Move(Geometry=merge_2, Motion=Y)  # -> Geometry, Transform
trim = TrimTree(Tree=[move_5.Geometry, move_6.Geometry], Depth=1)
merge_3 = Merge(Data1=split.Negative, Data2=trim)
mirror = Mirror(Geometry=merge_3, Plane=simplify(yz))  # -> reverse(Geometry), Transform
cullpt = CullDuplicates(Points=[merge_3, mirror.Geometry], Tolerance=0.1, CullMode=2)  # -> simplify(Points), Indices, Valence
pline = PolyLine(Vertices=cullpt.Points, Closed=invert(False))  # -> flatten(Polyline)
item_3 = ListItem(List=pline, Index=0, Wrap=True)  # -> Item1, Item
explode = Explode(Curve=pline, Recursive=True)  # -> simplify(Segments), Vertices
data = Data(item_3.Item)
flip = FlipMatrix(Data=explode.Segments)
c_script = CSharpScript(S=flip)  # -> out, M, msg; inputs S: list of Curve, u: Int32, closedU: Boolean, closedV: Boolean, triangulate: Boolean
# ---------- c_script: C# ----------
#region Usings
using System;
using System.Collections.Generic;
using Rhino;
using Rhino.Geometry;
#endregion

public class Script_Instance : GH_ScriptInstance
{
  // Try to extract polyline points. If it fails, return null.
  List<Point3d> GetPolylineVerts(Curve crv)
  {
    if (crv == null || !crv.IsValid) return null;

    Polyline pl;
    if (crv.TryGetPolyline(out pl))
    {
      var pts = new List<Point3d>(pl.Count);
      for (int i = 0; i < pl.Count; i++) pts.Add(pl[i]);
      return pts;
    }
    return null;
  }

  // Sample curve by normalized parameter t in [0..1] using arc length (more even spacing than parameter space).
  List<Point3d> SampleByLength(Curve crv, int uCount)
  {
    if (crv == null || !crv.IsValid) return null;
    if (uCount < 2) uCount = 2;

    double L = crv.GetLength();
    if (L <= RhinoMath.ZeroTolerance) return null;

    var pts = new List<Point3d>(uCount);

    for (int i = 0; i < uCount; i++)
    {
      double s = (double)i / (uCount - 1) * L;
      double t;
      if (!crv.LengthParameter(s, out t))
      {
        // fallback: normalized domain
        double tt = (double)i / (uCount - 1);
        pts.Add(crv.PointAtNormalizedLength(tt));
      }
      else
      {
        pts.Add(crv.PointAt(t));
      }
    }
    return pts;
  }

  // Build mesh loft: U = samples along section, V = section index
  Mesh BuildMeshLoft(List<List<Point3d>> grid, bool closedU, bool closedV, bool triangulate)
  {
    int vCount = grid.Count;
    int uCount = grid[0].Count;

    Mesh m = new Mesh();

    // Add vertices: (v,u) -> vertex index
    int[,] vid = new int[vCount, uCount];
    for (int v = 0; v < vCount; v++)
    {
      for (int u = 0; u < uCount; u++)
      {
        vid[v, u] = m.Vertices.Add(grid[v][u]);
      }
    }

    int uMax = closedU ? uCount : uCount - 1;
    int vMax = closedV ? vCount : vCount - 1;

    for (int v = 0; v < vMax; v++)
    {
      int vNext = (v + 1) % vCount;

      for (int u = 0; u < uMax; u++)
      {
        int uNext = (u + 1) % uCount;

        int a = vid[v,     u];
        int b = vid[v,     uNext];
        int c = vid[vNext, uNext];
        int d = vid[vNext, u];

        // If not closedU and we're at the last column, skip
        if (!closedU && u == uCount - 1) continue;
        // If not closedV and we're at the last row, skip
        if (!closedV && v == vCount - 1) continue;

        m.Faces.AddFace(a, b, c, d);
      }
    }

    if (triangulate)
      m.Faces.ConvertQuadsToTriangles();

    m.Normals.ComputeNormals();
    m.Compact();
    return m;
  }

  private void RunScript(
	List<Curve> S,
	int u,
	bool closedU,
	bool closedV,
	bool triangulate,
	ref object M,
	ref object msg)
  {
    msg = "";

    if (S == null || S.Count < 2)
    {
      M = null;
      msg = "Need at least 2 section curves.";
      return;
    }

    // Build per-section point lists
    var grid = new List<List<Point3d>>();
    int expectedU = -1;

    for (int i = 0; i < S.Count; i++)
    {
      Curve crv = S[i];
      if (crv == null || !crv.IsValid)
      {
        M = null;
        msg = $"Section {i} is null/invalid.";
        return;
      }

      List<Point3d> pts = null;

      if (u <= 0)
      {
        // Use polyline vertices mode
        pts = GetPolylineVerts(crv);
        if (pts == null)
        {
          M = null;
          msg = $"Section {i} is not a polyline. Set u > 0 to resample.";
          return;
        }

        // Many polylines are closed and repeat the first point at the end; remove duplicate end point.
        if (pts.Count >= 2 && pts[0].DistanceTo(pts[pts.Count - 1]) <= RhinoMath.ZeroTolerance)
          pts.RemoveAt(pts.Count - 1);
      }
      else
      {
        // Resample by arc length to u points
        pts = SampleByLength(crv, u);
        if (pts == null)
        {
          M = null;
          msg = $"Failed sampling section {i}.";
          return;
        }
      }

      if (pts.Count < 2)
      {
        M = null;
        msg = $"Section {i} has < 2 points after sampling.";
        return;
      }

      if (expectedU < 0) expectedU = pts.Count;
      if (pts.Count != expectedU)
      {
        M = null;
        msg = $"Point count mismatch at section {i}: got {pts.Count}, expected {expectedU}.";
        return;
      }

      grid.Add(pts);
    }

    // Build mesh
    Mesh mesh = BuildMeshLoft(grid, closedU, closedV, triangulate);
    if (mesh == null || mesh.Vertices.Count == 0)
    {
      M = null;
      msg = "Mesh build failed.";
      return;
    }

    msg = $"OK: sections={grid.Count}, U={grid[0].Count}, verts={mesh.Vertices.Count}, faces={mesh.Faces.Count}";
    M = mesh;
  }
}
# ---------- end c_script ----------
mesh = Mesh(c_script.M)
mjoin = MeshJoin(Meshes=flatten(mesh))
c_script_2 = CSharpScript(M=mjoin, I=Slider(1, range=0..7), B=Toggle(True))  # -> out, A; inputs M: Mesh, I: Int32, B: Boolean
# ---------- c_script_2: C# ----------
#region Usings
using System;
using System.Collections.Generic;
using Rhino;
using Rhino.Geometry;
#endregion

public class Script_Instance : GH_ScriptInstance
{
  private void RunScript(Mesh M, int I, bool B, ref object A)
  {
    if (M == null) { A = null; return; }

    int iters = Math.Max(0, I);

    // Work on a copy
    Mesh work = M.DuplicateMesh();

    // Optional cleanup to behave closer to "subdivision" expectations
    // (comment these out if you need to preserve seams/unwelded edges)
    work.Vertices.CombineIdentical(true, true);
    work.Weld(Math.PI);
    work.UnifyNormals();
    work.Compact();

    for (int k = 0; k < iters; k++)
      work = CatmullClark(work, B);

    work.Normals.ComputeNormals();
    work.Compact();
    A = work;
  }

  private Mesh CatmullClark(Mesh mesh, bool preserveBoundaries)
  {
    if (mesh == null) return null;
    if (mesh.Faces.Count == 0) return mesh.DuplicateMesh();

    // Ensure topology is up to date
    mesh.Compact();

    var topoV = mesh.TopologyVertices;
    var topoE = mesh.TopologyEdges;

    int tvCount = topoV.Count;
    int teCount = topoE.Count;
    int fCount = mesh.Faces.Count;

    // --- 1) Face points ---
    Point3d[] facePt = new Point3d[fCount];
    for (int fi = 0; fi < fCount; fi++)
    {
      MeshFace f = mesh.Faces[fi];
      int[] v = FaceTopoVertexIndices(mesh, f); // ordered corners in topo-vertex space

      Point3d sum = Point3d.Origin;
      for (int i = 0; i < v.Length; i++)
        sum += (Point3d)topoV[v[i]];

      facePt[fi] = sum / v.Length;
    }

    // --- 2) Edge points ---
    Point3d[] edgePt = new Point3d[teCount];
    for (int ei = 0; ei < teCount; ei++)
    {
      var tvPair = topoE.GetTopologyVertices(ei);
      int a = tvPair.I;
      int b = tvPair.J;

      Point3d pa = (Point3d)topoV[a];
      Point3d pb = (Point3d)topoV[b];

      int[] adjFaces = topoE.GetConnectedFaces(ei);

      if (preserveBoundaries && (adjFaces == null || adjFaces.Length == 1))
      {
        // boundary edge rule
        edgePt[ei] = 0.5 * (pa + pb);
      }
      else
      {
        // interior rule uses the two adjacent face points (or as many as exist)
        Point3d sum = pa + pb;
        int c = 2;

        if (adjFaces != null)
        {
          for (int j = 0; j < adjFaces.Length && j < 2; j++)
          {
            sum += facePt[adjFaces[j]];
            c++;
          }
        }

        edgePt[ei] = sum / c; // typically /4 for manifold interior edges
      }
    }

    // --- 3) New vertex points ---
    Point3d[] newVtx = new Point3d[tvCount];

    for (int vId = 0; vId < tvCount; vId++)
    {
      Point3d P = (Point3d)topoV[vId];

      int[] connFaces = topoV.ConnectedFaces(vId);
      int[] connEdges = topoV.ConnectedEdges(vId);

      if (connEdges == null || connEdges.Length == 0)
      {
        newVtx[vId] = P;
        continue;
      }

      // Detect boundary edges and boundary neighbors
      List<int> boundaryNeighbors = null;
      int boundaryEdgeCount = 0;

      if (preserveBoundaries)
      {
        boundaryNeighbors = new List<int>(4);
        foreach (int eId in connEdges)
        {
          int[] ef = topoE.GetConnectedFaces(eId);
          bool isBoundaryEdge = (ef == null || ef.Length == 1);
          if (!isBoundaryEdge) continue;

          boundaryEdgeCount++;

          var pair = topoE.GetTopologyVertices(eId);
          int other = (pair.I == vId) ? pair.J : pair.I;
          if (!boundaryNeighbors.Contains(other))
            boundaryNeighbors.Add(other);
        }
      }

      bool isBoundaryVertex = preserveBoundaries && boundaryEdgeCount > 0;

      if (isBoundaryVertex)
      {
        // Standard Catmull-Clark boundary vertex rule:
        // if vertex has exactly 2 boundary neighbors: (6P + N1 + N2)/8
        // if it's a corner (not exactly 2), keep it unchanged
        if (boundaryNeighbors != null && boundaryNeighbors.Count == 2)
        {
          Point3d N1 = (Point3d)topoV[boundaryNeighbors[0]];
          Point3d N2 = (Point3d)topoV[boundaryNeighbors[1]];
          newVtx[vId] = (6.0 * P + N1 + N2) / 8.0;
        }
        else
        {
          newVtx[vId] = P;
        }
      }
      else
      {
        // Interior Catmull-Clark vertex rule:
        // newP = (F + 2R + (n-3)P) / n
        int n = (connFaces != null) ? connFaces.Length : 0;
        if (n <= 0)
        {
          newVtx[vId] = P;
          continue;
        }

        // F = average of adjacent face points
        Point3d F = Point3d.Origin;
        for (int i = 0; i < connFaces.Length; i++)
          F += facePt[connFaces[i]];
        F /= connFaces.Length;

        // R = average of midpoints of adjacent edges (not edge points)
        Point3d R = Point3d.Origin;
        for (int i = 0; i < connEdges.Length; i++)
        {
          var pair = topoE.GetTopologyVertices(connEdges[i]);
          int other = (pair.I == vId) ? pair.J : pair.I;
          Point3d Po = (Point3d)topoV[other];
          R += 0.5 * (P + Po);
        }
        R /= connEdges.Length;

        newVtx[vId] = (F + 2.0 * R + (n - 3.0) * P) / n;
      }
    }

    // --- 4) Build the new mesh (all quads) ---
    Mesh outM = new Mesh();

    // Indices in out mesh:
    // 0..tvCount-1 = new vertex points
    // then teCount edge points
    // then fCount face points
    int[] outIndex_TopoV = new int[tvCount];
    int[] outIndex_Edge = new int[teCount];
    int[] outIndex_Face = new int[fCount];

    // Add vertex points
    for (int i = 0; i < tvCount; i++)
      outIndex_TopoV[i] = outM.Vertices.Add(newVtx[i]);

    // Add edge points
    for (int i = 0; i < teCount; i++)
      outIndex_Edge[i] = outM.Vertices.Add(edgePt[i]);

    // Add face points
    for (int i = 0; i < fCount; i++)
      outIndex_Face[i] = outM.Vertices.Add(facePt[i]);

    // Create new quad faces per original face corner
    for (int fi = 0; fi < fCount; fi++)
    {
      MeshFace f = mesh.Faces[fi];
      int[] corners = FaceTopoVertexIndices(mesh, f); // ordered

      int m = corners.Length;
      int faceIndex = outIndex_Face[fi];

      for (int j = 0; j < m; j++)
      {
        int vCurr = corners[j];
        int vNext = corners[(j + 1) % m];
        int vPrev = corners[(j - 1 + m) % m];

        int eNext = topoE.GetEdgeIndex(vCurr, vNext);
        int ePrev = topoE.GetEdgeIndex(vPrev, vCurr);

        if (eNext < 0 || ePrev < 0) continue;

        int a = outIndex_TopoV[vCurr];
        int b = outIndex_Edge[eNext];
        int c = faceIndex;
        int d = outIndex_Edge[ePrev];

        outM.Faces.AddFace(a, b, c, d);
      }
    }

    outM.Normals.ComputeNormals();
    outM.Compact();
    return outM;
  }

  // Returns ordered corner topology-vertex indices for a MeshFace (tri or quad)
  private int[] FaceTopoVertexIndices(Mesh mesh, MeshFace f)
  {
    int ta = mesh.TopologyVertices.TopologyVertexIndex(f.A);
    int tb = mesh.TopologyVertices.TopologyVertexIndex(f.B);
    int tc = mesh.TopologyVertices.TopologyVertexIndex(f.C);

    if (f.IsTriangle)
      return new int[] { ta, tb, tc };

    int td = mesh.TopologyVertices.TopologyVertexIndex(f.D);
    return new int[] { ta, tb, tc, td };
  }
}
# ---------- end c_script_2 ----------
medges = MeshEdges(Mesh=c_script_2.A)  # -> NakedEdges, InteriorEdges, NonManifoldEdges
data_2 = Data(medges.NakedEdges)
join = JoinCurves(Curves=data_2, Preserve=False)
item_4 = ListItem(List=join, Index=0, Wrap=True)
explode_2 = Explode(Curve=item_4, Recursive=True)  # -> simplify(Segments), Vertices
cull_i = CullIndex(List=explode_2.Vertices, Indices=-1, Wrap=True)
plfit = PlaneFit(Points=explode_2.Vertices)  # -> Plane, Deviation
del = DelaunayMesh(Points=cull_i, Plane=plfit.Plane)
mjoin_2 = MeshJoin(Meshes=flatten([del, c_script_2.A]))
area = Area(Geometry=mjoin_2)  # -> Area, Centroid
subtraction = Subtraction(A=pt_2, B=area.Centroid)
yz_2 = YZPlane(Origin=area.Centroid)
addition = Addition(A=subtraction, B=Z)
rotate = Rotate(Geometry=mjoin_2, Angle=pi, Plane=yz_2)  # -> Geometry, Transform
move_7 = Move(Geometry=rotate.Geometry, Motion=addition)  # -> Geometry, Transform
flip_2 = MeshFlip(Mesh=move_7.Geometry)
demesh = DeconstructMesh(Mesh=move_7.Geometry)  # -> Vertices, Faces, Colours, Normals
flip_3 = MeshFlip(Mesh=move_7.Geometry)
mcol = MeshColours(Mesh=move_7.Geometry, Colours=demesh.Normals)
mjoin_3 = MeshJoin(Meshes=[move_7.Geometry, flip_3])
c_script_3 = CSharpScript(mesh=mjoin_3)  # -> base64Draco; inputs mesh: Mesh
# ---------- c_script_3: C# ----------
    var options = new Rhino.FileIO.DracoCompressionOptions();
    options.CompressionLevel = 5;
    options.IncludeTextureCoordinates = false;
    options.IncludeVertexColors = true;

    var compressed = Rhino.FileIO.DracoCompression.Compress(mesh, options);
    base64Draco = compressed.ToBase64String();
# ---------- end c_script_3 ----------
rh_out_mesh_m = Mesh([move_7.Geometry, flip_3])
context_print = ContextPrint(MeshB64=c_script_3)
