# Grasshopper definition test02.gh (Grasshopper 1.0.8)

pt = Point(Tree({0}: [Point(0, 800, 10.75790194), Point(34.72598587, 800, 8.75790194), Point(55, 800, -11.24209806), Point(61.91968224, 800, -37.60116137), Point(56.91968224, 800, -50.4348426), Point(51.34551169, 800, -99.87876893), Point(14.72598587, 800, -116.8787689), Point(0, 800, -116.8787689)], {1}: [Point(0, 881.3343783, 18.25790194), Point(34.72598587, 881.3343783, 18.25790194), Point(82.33763683, 881.3343783, 15.25790194), Point(82.33763683, 881.3343783, -38.60116137), Point(115.2124651, 881.3343783, -48.22949273), Point(97.85521735, 881.3343783, -92.31802166), Point(25.72598587, 881.3343783, -141.8787689), Point(0, 881.3343783, -141.8787689)], {2}: [Point(0, 998.0771873, 18.25790194), Point(34.72598587, 998.0771873, 18.25790194), Point(82.33763683, 998.0771873, 15.25790194), Point(82.33763683, 998.0771873, -38.60116137), Point(115.2124651, 998.0771873, -55.08805662), Point(97.85521735, 998.0771873, -92.31802166), Point(25.72598587, 998.0771873, -141.8787689), Point(0, 998.0771873, -141.8787689)], {3}: [Point(0, 1152.957751, 1.854295127), Point(14.72598587, 1152.957751, 1.854295127), Point(30, 1162.957751, -9.704530279), Point(30, 1162.957751, -20.69167303), Point(27.64558823, 1150.457751, -39.21586264), Point(27.64558823, 1140.457751, -54.34253224), Point(18.72598587, 1130, -69.73790245), Point(0, 1130, -69.73790245)]))
item = ListItem(List=pt, Index=0, Wrap=True)
split = SplitTree(Data=pt, Masks=flatten("{1,2}"))  # -> Positive, Negative
yz = YZPlane(Origin=item)
item_2 = ListItem(List=flatten(yz), Index=0, Wrap=True)
partition = PartitionList(List=split.Positive, Size="2")
bang = ExplodeTree(Data=partition)  # -> Branch0, Branch1, Branch2, Branch3, Branch4, Branch5, Branch6, Branch7
number_slider = Slider(11, range=0..20)
number_slider_2 = Slider(14, range=0..20)
number_slider_3 = Slider(11, range=2..20)
number_slider_4 = Slider(17, range=0..20)
pt_2 = Point(Point(0, 0, 0))
yz_2 = YZPlane(Origin=item_2)
data = Data()
rotate = Rotate(Geometry=data, Angle=1.570796327, Plane=yz_2)  # -> Geometry, Transform
xy = XYPlane(Origin=yz_2)
pi = Pi(Factor=1)
rotate_2 = Rotate(Geometry=rotate.Geometry, Angle=pi, Plane=xy)  # -> Geometry, Transform

hullwidth = Slider(-10, range=-10..10)
wingspan = Slider(10, range=-10..10)
wingstart = Slider(0, range=-10..10)
wingend = Slider(0, range=-10..10)

hullwidth_2 = GetNumber(hullwidth, AtLeast=0, AtMost=2, Maximum=1.797693135e+308, Minimum=-1.797693135e+308, TreeAccess=False)
wingspan_2 = GetNumber(wingspan, AtLeast=1, AtMost=2147483647, Maximum=1.797693135e+308, Minimum=-1.797693135e+308, TreeAccess=False)
wingstart_2 = GetNumber(wingstart, AtLeast=1, AtMost=2147483647, Maximum=1.797693135e+308, Minimum=-1.797693135e+308, TreeAccess=False)
wingend_2 = GetNumber(wingend, AtLeast=1, AtMost=2147483647, Maximum=1.797693135e+308, Minimum=-1.797693135e+308, TreeAccess=False)

remap = RemapNumbers(Value=hullwidth_2, Source="-10 to 10", Target="2 to 10")  # -> Mapped, Clipped
remap_2 = RemapNumbers(Value=wingstart_2, Source="-10 to 10", Target="-10 to 15")  # -> Mapped, Clipped
remap_3 = RemapNumbers(Value=wingend_2, Source="-10 to 10", Target="-10 to 15")  # -> Mapped, Clipped
remap_4 = RemapNumbers(Value=wingspan_2, Source="-10 to 10", Target="-5 to 12")  # -> Mapped, Clipped
multiplication = Multiplication(A=remap_4.Mapped, B="5")
multiplication_2 = Multiplication(A=remap.Clipped, B="5")
multiplication_3 = Multiplication(A=remap_2.Mapped, B="5")
multiplication_4 = Multiplication(A=remap_3.Mapped, B="5")

Y = UnitY(Factor=multiplication_4)
Y_2 = UnitY(Factor=multiplication_3)
X = UnitX(Factor=multiplication_2)
X_2 = UnitX(Factor=multiplication)

move = Move(Geometry=bang.Branch1, Motion=X)  # -> Geometry, Transform
move_2 = Move(Geometry=bang.Branch2, Motion=X_2)  # -> Geometry, Transform
move_3 = Move(Geometry=bang.Branch5, Motion=X)  # -> Geometry, Transform
move_4 = Move(Geometry=bang.Branch6, Motion=X_2)  # -> Geometry, Transform
merge = Merge(Data1=bang.Branch0, Data2=move.Geometry, Data3=move_2.Geometry, Data4=bang.Branch3)
merge_2 = Merge(Data1=bang.Branch4, Data2=move_3.Geometry, Data3=move_4.Geometry, Data4=bang.Branch7)
move_5 = Move(Geometry=merge, Motion=Y_2)  # -> Geometry, Transform
move_6 = Move(Geometry=merge_2, Motion=Y)  # -> Geometry, Transform
trim = TrimTree(Tree=[move_5.Geometry, move_6.Geometry], Depth=1)
merge_3 = Merge(Data1=split.Negative, Data2=trim)
mirror = Mirror(Geometry=merge_3, Plane=simplify(yz))  # -> reverse(Geometry), Transform
cullpt = CullDuplicates(Points=[merge_3, mirror.Geometry], Tolerance=0.1, CullMode=2)  # -> simplify(Points), Indices, Valence
pline = PolyLine(Vertices=cullpt.Points, Closed=invert(False))  # -> flatten(Polyline)
item_3 = ListItem(List=pline, Index=0, Wrap=True)  # -> Item1, Item
explode = Explode(Curve=pline, Recursive=True)  # -> simplify(Segments), Vertices
flip = FlipMatrix(Data=explode.Segments)
loft = Loft(Curves=flip, Options={Adjust=False, Closed=False, LoftEnds=0, LoftSimp=0, LoftType=0, Rebuild=10, Refit=0.01})
mesh = MeshBrep(
    Brep=flatten(loft),
    Settings={GridMaxCount=0, GridMinCount=16, JaggedSeams=False, MaxEdgeLength=0, MinEdgeLength=0.0001, MinTolerance=0, Refine=True, RefineAngle=0, RelativeTolerance=0.65, SimplePlanes=True, Tolerance=0})
join = BrepJoin(Breps=reverse(flatten(loft)))  # -> Breps, Closed
mjoin = MeshJoin(Meshes=mesh)
area = Area(Geometry=mjoin)  # -> Area, Centroid
subtraction = Subtraction(A=pt_2, B=area.Centroid)
move_7 = Move(Geometry=mjoin, Motion=subtraction)  # -> Geometry, Transform

# ---- group: RH_OUT:mesh_m
mesh_2 = Mesh(move_7.Geometry)
